# Grasshopper definition CityScope_RH_GH_Template.gh (Grasshopper 0.9.76)
# plug-ins: Python Interpreter, Firefly.X, HDTReference

# ---- group: Int Grid X Extent
number_slider = Slider(16, range=1..20)

# ---- group: Int Grid Y Extent
number_slider_2 = Slider(16, range=1..20)

# ---- group: module meshes lego ref: -1
# Reference in Rhino File
# Building Type Mesh
mesh = Mesh(<mesh referenced from the Rhino model>)

# ---- group: module meshes lego ref: 0 to 5
# Reference in the Building or Road
# geometry from Rhino. They will be
# instantiated/copied to the cell position
# where it has the same Type ID.
# 
# To simplify the data tree. The reference
# geometry should be single Mesh. You
# can paint different mesh with the set-up
# on the right, and join them together.
mesh_2 = Mesh([<mesh referenced from the Rhino model> x6])

# ----
# CityMatrix CV
# You need to adjust the file path to:
# "[your github folder]\CS_Rhino_Grasshopper_Template\maps\CityMatrix_ML_Cam.PNG"
path = FilePath("C:\Users\RYAN\Documents\GitHub\CS_Rhino_Grasshopper_Template\maps\CityMatrix_ML_Cam.PNG")
# Everthing below this line is only for
# CityScope scanning. You need a
# physical CityScope table. Or at least
# a screenshot of the camera reading
# of the CityScope table.
load_bitmap = LoadBitmap(FilePathToImageLocation=path)

# ----
# You need firefly plugin for this. It streams
# the Webcam footage from the CityMatrix
# Table. (It is now disabled and we are now
# using the text data fomat. )
# 
# Ideal setting (right click):
# 100ms
# 480px x 360px
video_stream = WebCamVideoStream()  # disabled

# ---- group: all color code quarts (no rotation)
panel = Panel("2,0,0,0\t2,1,0,0\t2,0,1,0\t2,0,0,1\t2,1,1,0\t2,1,0,1\t2,0,1,1\t2,1,1,1\t3,0,0,0\t3,1,0,0\t3,0,1,0\t3,0,0,1\t3,1,1,0\t3,1,0,1\t3,0,1,1\t3,1,1,1\t4,0,0,0\t4,1,0,0\t4,0,1,0\t4,0,0,1\t4,1,1,0\t4,1,0,1\t4,0,1,1\t4,1,1,1\t5,0,0,0\t5,1,0,0\t5,0,1,0\t5,0,0,1\t5,1,1,0\t5,1,0,1\t5,0,1,1\t5,1,1,1")

# ---- group: Pts Sample Grid Corner
# Grid Sampling
pt = Point([<point referenced from the Rhino model> x4])

# ---- group: all color code quarts (with rotation)
# Decode Piece ID
panel_2 = Panel("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")

# ----
pline = PolyLine(Vertices=pt, Closed=False)

# ---- group: Sample White
# Reference Color
pt_2 = Point(<point referenced from the Rhino model>)

# ---- group: Sample Black
pt_3 = Point(<point referenced from the Rhino model>)

# ---- group: Sample Red
pt_4 = Point(<point referenced from the Rhino model>)

# ---- group: gridExtent_y
int = Integer(number_slider_2)

# ----
preview = CustomPreview(Geometry=pline, Shader=ColourSwatch(SwatchColor=RGB(255, 0, 230)))

# ---- group: gridExtent_x
int_2 = Integer(number_slider)

# ---- group: mesh coloring
mesh_3 = Mesh(<mesh referenced from the Rhino model>)
res_color = ColourSwatch(SwatchColor=RGB(251, 255, 122))
sidewalk = ColourSwatch(SwatchColor=RGB(107, 107, 107))
res_gray = ColourSwatch(SwatchColor=RGB(227, 227, 227))
bikelane = ColourSwatch(SwatchColor=RGB(86, 135, 87))
off_gray = ColourSwatch(SwatchColor=RGB(171, 171, 171))
offcolor = ColourSwatch(SwatchColor=RGB(255, 122, 122))
parking = ColourSwatch(SwatchColor=RGB(196, 156, 100))
blank = ColourSwatch(SwatchColor=RGB(110, 110, 110))
road = ColourSwatch(SwatchColor=RGB(64, 64, 64))
park = ColourSwatch(SwatchColor=RGB(165, 201, 44))
text = ColourSwatch(SwatchColor=RGB(0, 0, 0))
res_warm = ColourSwatch(SwatchColor=RGB(255, 251, 230))
text_new = ColourSwatch(SwatchColor=RGB(64, 64, 64))
off_cold = ColourSwatch(SwatchColor=RGB(230, 242, 255))
mcol = MeshColours(Mesh=mesh_3, Colours=off_cold)
mesh_4 = Mesh(mcol)

# ----
multiplication = Multiplication(A=int, B=2)
multiplication_2 = Multiplication(A=int_2, B=2)
crv = Curve(<curve referenced from the Rhino model>)
crv_2 = Curve(<curve referenced from the Rhino model>)
crv_3 = Curve(<curve referenced from the Rhino model>)
boundary = BoundarySurfaces(Edges=crv)
boundary_2 = BoundarySurfaces(Edges=crv_3)
boundary_3 = BoundarySurfaces(Edges=crv_2)

# ---- group: webcam stream
# You can feed a screen shot of the camera
# stream into the "webcam stream", when
# you don't have a CityMatrix table near
# you.
data = Data(load_bitmap)

# ----
perspective = Perspective(pt=pt, int_2=multiplication_2, int=multiplication)

# ---- group: tab
panel_3 = Panel("\t")

# ----
split = TextSplit(Text=panel_2, Separators=panel_3)
mesh_5 = MeshBrep(
    Brep=boundary,
    Settings={GridMaxCount=0, GridMinCount=16, JaggedSeams=False, MaxEdgeLength=0, MinEdgeLength=0.0001, MinTolerance=0, Refine=True, RefineAngle=0, RelativeTolerance=0.65, SimplePlanes=True, Tolerance=0})
mesh_6 = MeshBrep(
    Brep=boundary_2,
    Settings={GridMaxCount=0, GridMinCount=16, JaggedSeams=False, MaxEdgeLength=0, MinEdgeLength=0.0001, MinTolerance=0, Refine=True, RefineAngle=0, RelativeTolerance=0.65, SimplePlanes=True, Tolerance=0})
mesh_7 = MeshBrep(
    Brep=boundary_3,
    Settings={GridMaxCount=0, GridMinCount=16, JaggedSeams=False, MaxEdgeLength=0, MinEdgeLength=0.0001, MinTolerance=0, Refine=True, RefineAngle=0, RelativeTolerance=0.65, SimplePlanes=True, Tolerance=0})

# ---- group: CityMatrix CV Calibration
mesh_8 = MeshFromImage(Bmp=data, Sx=Domain(0, 1), Sy=Domain(0, 1), Z=0, C=True)

# ---- group: all color quarts data
txt = Text(split)

# ----
lng = ListLength(List=txt)

# ---- group: webcam stream
bmp = BitmapToModify(data)

# ----
sample = BitmapSampler(BitmapToModify=bmp, PointToSample=pt_3, BitmapToModify_2=bmp, PointToSample_2=pt_3, bitmap_filter=0)  # -> SampledImageData, SampledImageData_2
sample_2 = BitmapSampler(BitmapToModify=bmp, PointToSample=pt_4, BitmapToModify_2=bmp, PointToSample_2=pt_4, bitmap_filter=0)  # -> SampledImageData, SampledImageData_2
sample_3 = BitmapSampler(BitmapToModify=bmp, PointToSample=pt_2, BitmapToModify_2=bmp, PointToSample_2=pt_2, bitmap_filter=0)  # -> SampledImageData, SampledImageData_2

# ---- group: x
series = Series(Start=0, Step=1, Count=int_2)

# ---- group: y
series_2 = Series(Start=0, Step=1, Count=int)

# ----
division = Division(A=lng, B="4")

# ---- group: webcam stream
bmp_2 = BitmapToModify(data)

# ----
col = Colour(sample_3.SampledImageData_2)
col_2 = Colour(sample.SampledImageData_2)
col_3 = Colour(sample_2.SampledImageData_2)
panel_4 = Panel(txt)
multiplication_3 = Multiplication(A=series_2, B=4)
series_3 = Series(Start=0, Step=1, Count=division)
mcol_2 = MeshColours(Mesh=mesh_5, Colours=col_2)
mcol_3 = MeshColours(Mesh=mesh_6, Colours=col_3)
mcol_4 = MeshColours(Mesh=mesh_7, Colours=col)
multiplication_4 = Multiplication(A=series, B=2)

# ---- group: keystoned grid pts
pt_5 = Point(perspective)

# ----
pshift = ShiftPaths(Data=series_3, Offset=-1)
multiplication_5 = Multiplication(A=division, B="4")
# Defining the floor number for each
# building type.
panel_5 = Panel("""5,6,2,2,2,2,6,1,1,1,1,6,1,1,1,1
6,6,6,6,6,6,6,6,6,6,6,6,6,6,6,6
2,6,5,5,5,5,6,4,4,4,4,6,1,1,1,1
2,6,5,-1,-1,5,6,4,-1,-1,4,6,1,-1,-1,1
2,6,5,-1,-1,5,6,4,-1,-1,4,6,1,-1,-1,1
2,6,5,5,5,5,6,4,4,4,4,6,1,1,1,1
6,6,6,6,6,6,6,6,6,6,6,6,6,6,6,6
2,6,2,2,2,2,6,3,3,3,3,6,3,3,3,3
2,6,2,-1,-1,2,6,3,-1,-1,3,6,3,-1,-1,3
2,6,2,-1,-1,2,6,3,-1,-1,3,6,3,-1,-1,3
2,6,2,2,2,2,6,3,3,3,3,6,3,3,3,3
6,6,6,6,6,6,6,6,6,6,6,6,6,6,6,6
0,6,0,0,0,0,6,0,0,0,0,6,0,0,0,0
0,6,0,-1,-1,0,6,0,-1,-1,0,6,0,-1,-1,0
0,6,0,-1,-1,0,6,0,-1,-1,0,6,0,-1,-1,0
0,6,0,0,0,0,6,0,0,0,0,6,0,0,0,3""")
multiplication_6 = Multiplication(A=multiplication_3, B=int_2)
pshift_2 = ShiftPaths(Data=pt_5, Offset=-1)

# ---- group: all sample pts
pt_6 = Point(pshift_2)

# ----
sample_4 = BitmapSampler(BitmapToModify=bmp_2, PointToSample=pt_6, BitmapToModify_2=bmp_2, PointToSample_2=pt_6, bitmap_filter=0)  # -> SampledImageData, SampledImageData_2
preview_2 = CustomPreview(
    Geometry=mcol_2,
    Shader={ambient=RGB(0, 0, 0), diffuse=RGB(255, 105, 180), emission=RGB(76, 32, 54), shine=0.5, specular=RGB(255, 255, 255), transparency=0})
preview_3 = CustomPreview(
    Geometry=mcol_3,
    Shader={ambient=RGB(0, 0, 0), diffuse=RGB(255, 105, 180), emission=RGB(76, 32, 54), shine=0.5, specular=RGB(255, 255, 255), transparency=0})
preview_4 = CustomPreview(
    Geometry=mcol_4,
    Shader={ambient=RGB(0, 0, 0), diffuse=RGB(255, 105, 180), emission=RGB(76, 32, 54), shine=0.5, specular=RGB(255, 255, 255), transparency=0})
box = CenterBox(Base=pt_6, X=0.003, Y=0.003, Z=0.003)
repeat = RepeatData(Data=pshift, Length=multiplication_5)
addition = Addition(A=multiplication_4, B=graft(multiplication_6))
merge = Merge(Data1=col, Data2=col_2, Data3=col_3)

_4_commed = Slider(20, range=1..25)
_1_resmed = Slider(5, range=1..25)
_3_comhq = Slider(15, range=1..25)
# Parameters
# Building Heights
_0_reslux = Slider(1, range=1..25)
_2_resmu = Slider(10, range=1..25)
_5_rescw = Slider(25, range=1..25)

pshift_3 = ShiftPaths(Data=repeat, Offset=-1)

# ---- group: all color quart ids
int_3 = Integer(pshift_3)

# ---- group: all sample color
col_4 = Colour(sample_4.SampledImageData_2)

# ---- group: all sample boxes
box_2 = Box(box)

# ---- group: all piece ids
int_4 = Integer([0, 6, 2, 2, 2, 2, 6, 1, 1, 1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])

# ----
txt_2 = Text(int_4)
pshift_4 = ShiftPaths(Data=addition, Offset=-1)
join = TextJoin(Text=txt_2, Join=",")
multiplication_7 = Multiplication(A=int_2, B=2)
panel_6 = Panel(int_3)

# ---- group: all ref colors
col_5 = Colour([RGB(198, 184, 140), RGB(96, 87, 65), RGB(153, 81, 42)])

# ----
addition_2 = Addition(A=pshift_4, B=multiplication_7)
addition_3 = Addition(A=pshift_4, B=1)
int_5 = Integer(_5_rescw)
int_6 = Integer(_4_commed)
int_7 = Integer(_2_resmu)
int_8 = Integer(_3_comhq)
int_9 = Integer(_1_resmed)
int_10 = Integer(_0_reslux)
merge_2 = Merge(Data1=int_10, Data2=int_9, Data3=int_7, Data4=int_8, Data5=int_6, Data6=int_5)
addition_4 = Addition(A=addition_2, B=1)
textformating = TextFormating(txt=panel_5)
# Closest Color Code
dist = Distance(PointA=graft(col_4), PointB=col_5)

# ---- group: floor height
panel_7 = Panel("3.5")

# ---- group: floor num for each type
int_11 = Integer(merge_2)

# ----
lng_2 = ListLength(List=dist)
series_4 = Series(Start=0, Step=1, Count=lng_2)
multiplication_8 = Multiplication(A=int_11, B=panel_7)

# ---- group: all module piece ids - from Text Data
int_12 = Integer(textformating)

# ----
int_13 = Integer(series_4)
sort = SortList(Keys=dist, ValuesA=int_13)  # -> Keys, ValuesA

# ---- group: sample pts
item = ListItem(List=pt_6, Index=addition_2, Wrap=False)
item_2 = ListItem(List=pt_6, Index=pshift_4, Wrap=False)
item_3 = ListItem(List=pt_6, Index=addition_4, Wrap=False)
item_4 = ListItem(List=pt_6, Index=addition_3, Wrap=False)

# ----
addition_5 = Addition(A=item_2, B=item_3)

# ---- group: building height for each type
# CityMatrix
# 
# "Ryan" Yan Zhang <ryanz@mit.edu>
# MIT Media Lab, Changing Place Group
# September. 2016
# Here you choose to use Text Data that you
# can edit or CityMatrix CV.
# 
# For Text Data, simple edit the text panel on
# the left (arrow 1), by change the ID in each
# slot, you change what building module to
# copy to the stage. Currently, ID -1 is blank,
# ID 0 to 5 are 6 different building type.
# 
# For CityMatrix CV, rewire this (arrow 2) and
# enable the video stream (arrow 3). Contact
# me for using and calibrating the physical
# CityMatrix table. <ryanz@mit.edu>
num = Number(multiplication_8)

# ----
item_5 = ListItem(List=sort.ValuesA, Index=0, Wrap=False)
division_2 = Division(A=addition_5, B=2)

# ---- group: quart mid pts
pt_7 = Point(division_2)

# ----
pshift_5 = ShiftPaths(Data=item_5, Offset=-1)

# ---- group: module id
int_14 = Integer(int_12)

# ---- group: x
int_15 = Integer([0, 1, 2, 3, 4, 5, 6, 7, 8, 9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])

# ---- group: y
int_16 = Integer([0, 0, 0, 0, 0, 0, 0, 0, 0, 0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])

# ---- group: rotation
int_17 = Integer([0, 0, 0, 0, 0, 0, 0, 0, 0, 0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])

# ----
pshift_6 = ShiftPaths(Data=pshift_5, Offset=-1)
panel_8 = Panel(int_14)
panel_9 = Panel(int_17)
panel_10 = Panel(int_15)
panel_11 = Panel(int_16)

# ---- group: color code of each smaple pt
int_18 = Integer(pshift_6)

# ----
item_6 = ListItem(List=col_5, Index=int_18, Wrap=False)
preview_5 = CustomPreview(Geometry=box_2, Shader=item_6)

# ---- group: color codes
item_7 = ListItem(List=int_18, Index=pshift_4, Wrap=False)
item_8 = ListItem(List=int_18, Index=addition_2, Wrap=False)
item_9 = ListItem(List=int_18, Index=addition_4, Wrap=False)
item_10 = ListItem(List=int_18, Index=addition_3, Wrap=False)

# ----
merge_3 = Merge(Data1=graft(item_7), Data2=graft(item_8), Data3=graft(item_9), Data4=graft(item_10))

# ---- group: color code quarts
int_19 = Integer(merge_3)

# ----
rev = ReverseList(List=int_19)
txt_3 = Text(rev)
join_2 = TextJoin(Text=txt_3, Join=",")
pshift_7 = ShiftPaths(Data=join_2, Offset=-1)

# ---- group: color code quart texts
txt_4 = Text(pshift_7)

# ----
keysearch = KeyValueSearch(Keys=txt, Values=int_3, Search=graft(txt_4))
nullrep = ReplaceNulls(Items=keysearch, Replacements="-1")  # -> Items, Count
pshift_8 = ShiftPaths(Data=nullrep.Items, Offset=-1)

# ---- group: all module piece ids
int_20 = Integer(pshift_8)

# ----
tag = TextTag3D(Location=pt_7, Text=int_20, Size=0.01, Justification=5)
panel_12 = Panel(int_20)

# ---- group: all module piece ids - from CityMatrix CV
int_21 = Integer(int_20)

# ---- group: intervention
panel_13 = Panel("0.00001")
panel_14 = Panel("0")

# ----
pt_8 = ConstructPoint(XCoordinate=int_15, YCoordinate=int_16, ZCoordinate=0)
pt_9 = ConstructPoint(XCoordinate=panel_13, YCoordinate=panel_14, ZCoordinate=0)

# ----
# Here's the code for the abstract point
# color example I shown in the class.
# It's a very good starting point to build
# your own logic without worring about
# the output part too much.
# 
# Currently, move arround the 2 reference
# points will change the heatmap.
# 
# Mind that the x,y coordinate is from
# 0 to 15, so it is pretty small. Zoom in to
# see the points, or you can use Camera
# "HeatMapPts" saved for you.
pt_10 = Point(<point referenced from the Rhino model>)
pt_11 = Point(<point referenced from the Rhino model>)

dist_2 = Distance(PointA=pt_11, PointB=pt_8)
dist_3 = Distance(PointA=pt_10, PointB=pt_8)
min = Minimum(A=dist_3, B=dist_2)
panel_15 = Panel(min)

# ---- group: safety score
division_3 = Division(A="1", B=panel_15)

# ----
panel_16 = Panel(division_3)
gradient = Gradient(LowerLimit=0, UpperLimit=1, Parameter=division_3, stops=[0: RGB(255, 0, 0), 0.5: RGB(255, 255, 0), 1: RGB(0, 128, 0)])
preview_6 = CustomPreview(Geometry=pt_8, Shader=gradient)

# ---- group: gridExtent_x
int_22 = Integer(int_2)

# ---- group: shrink
cell_shrink = Slider(0.98, range=0.75..1)

# ---- group: toggle1
bool = Boolean(False)

# ---- group: gridExtent_y
int_23 = Integer(int)

# ---- group: rotation
int_24 = Integer(int_17)

# ---- group: module id
int_25 = Integer(int_14)

# ---- group: y
int_26 = Integer(int_16)

# ---- group: x
int_27 = Integer(int_15)

# ---- group: colortizer orgin
# LEGO Grid System Visualization
pt_12 = Point(<point referenced from the Rhino model>)

# ---- group: table size ref pt
pt_13 = Point(<point referenced from the Rhino model>)

# ----
Z = UnitZ(Factor=20)
panel_17 = Panel("C:\Users\RYAN\Dropbox (MIT)\01_Work\MAS\06_Fall 2016\CityMatrix\01_Software\RH_GH\Map\HAMBURG RS 1600pxl.jpg")

# ----
# Google Map @ Lego
show_google_map = BooleanToggle(False)

# ---- group: y
int_28 = Integer(flatten(int_16))

# ---- group: module id
# JSON Text Composer
int_29 = Integer(flatten(int_14))

# ---- group: x
int_30 = Integer(flatten(int_15))

# ---- group: rotation
int_31 = Integer(flatten(int_17))

# ---- group: slider1
num_2 = Number(flatten("0.0"))

# ---- group: toggle1
bool_2 = Boolean(flatten("False"))

# ---- group: dockID
int_32 = Integer(flatten("-1"))

# ---- group: dockRotation
int_33 = Integer(flatten("0"))

# ---- group: density
int_34 = Integer(flatten(int_11))

# ----
xy = XYPlane(Origin=pt_12)
dist_4 = Distance(PointA=pt_12, PointB=pt_13)
timer = Timer(TimerInterval=500, Target=division_4)  # disabled
division_4 = Division(A=dist_4, B=int_22)
movetoorgin = MoveToOrgin(G=mesh, num=cell_shrink)
movetoorgin_2 = MoveToOrgin(G=mesh_2, num=cell_shrink)

# ---- group: base cplane
pln = Plane(xy)

# ----
planesrf = PlaneSurface(Plane=pln, XSize=Domain(0, 1000), YSize=Domain(-1000, 0))
move = Move(Geometry=planesrf, Motion=Z)  # -> Geometry, Transform
filter = StreamFilter(Gate=show_google_map, Stream1=move.Geometry)
building_heights = Text(flatten(int_34))

# ---- group: cell size
num_3 = Number(division_4)

# ----
modulecenter = ModuleCenter(pt=pt_12, num=num_3, int_2=int_27, int=int_26)  # -> pt_5, transform_2
previewmat = CustomPreviewMaterials(Geometry=filter, DiffuseColor=ColourSwatch(SwatchColor=RGB(255, 255, 255)), Transparency="0.0", DiffuseBitmap=panel_17)
txt_5 = Text(int_31)
txt_6 = Text(int_29)
txt_7 = Text(int_30)
txt_8 = Text(int_28)
txt_9 = Text(int_32)
int_35 = Integer(bool_2)
txt_10 = Text(int_33)
txt_11 = Text(num_2)
txt_12 = Text(building_heights)

# ---- group: module meshes lego at orgin
mesh_9 = Mesh(movetoorgin_2)

mesh_10 = Mesh(movetoorgin)

# ----
txt_13 = Text(int_35)

# ---- group: module center
pt_14 = Point(modulecenter.pt_5)

# ----
lng_3 = ListLength(List=txt_6)
repeat_2 = RepeatData(Data=",\"rot\":", Length=lng_3)
repeat_3 = RepeatData(Data="}", Length=lng_3)
repeat_4 = RepeatData(Data=",\"y\":", Length=lng_3)
repeat_5 = RepeatData(Data=",\"x\":", Length=lng_3)
repeat_6 = RepeatData(Data="{\"type\":", Length=lng_3)
join_3 = TextJoin(Text=txt_12, Join=",")
pshift_9 = ShiftPaths(Data=repeat_2, Offset=-1)
pshift_10 = ShiftPaths(Data=repeat_3, Offset=-1)
pshift_11 = ShiftPaths(Data=repeat_5, Offset=-1)
pshift_12 = ShiftPaths(Data=repeat_4, Offset=-1)
pshift_13 = ShiftPaths(Data=repeat_6, Offset=-1)
larger = LargerThan(FirstNumber=int_25, SecondNumber="0")  # -> LargerThan, OrEqualTo
smaller = SmallerThan(FirstNumber=int_25, SecondNumber="5")  # -> SmallerThan, OrEqualTo
merge_4 = Merge(
    Data1=graft(pshift_13),
    Data2=graft(txt_6),
    Data3=graft(pshift_11),
    Data4=graft(txt_7),
    Data5=graft(pshift_12),
    Data6=graft(txt_8),
    Data7=graft(pshift_9),
    Data8=graft(txt_5),
    Data9=graft(pshift_10))
and = GateAnd(A=larger.OrEqualTo, B=smaller.OrEqualTo)
join_4 = TextJoin(Text=merge_4)
dispatch = Dispatch(List=int_25, DispatchPattern=and)  # -> ListA, ListB
smaller_2 = SmallerThan(FirstNumber=int_25, SecondNumber="0")  # -> SmallerThan, OrEqualTo
pshift_14 = ShiftPaths(Data=join_4, Offset=-1)
item_11 = ListItem(List=mesh_9, Index=graft(dispatch.ListA), Wrap=False)
dispatch_2 = Dispatch(List=pt_14, DispatchPattern=smaller_2.SmallerThan)  # -> ListA, ListB
txt_14 = Text(pshift_14)
join_5 = TextJoin(Text=txt_14, Join=",")
txt_15 = Text(join_5)
pshift_15 = ShiftPaths(Data=item_11, Offset=-1)
dispatch_3 = Dispatch(List=int_24, DispatchPattern=and)  # -> ListA, ListB
merge_5 = Merge(
    Data1="{\"grid\":[",
    Data2=txt_15,
    Data3="],\"objects\":{",
    Data4="\"slider1\":",
    Data5=txt_11,
    Data6=",\"toggle1\":",
    Data7=txt_13,
    Data8=",\"dockID\":",
    Data9=txt_9,
    Data10=",\"dockRotation\":",
    Data11=txt_10,
    Data13=",\"density\":[",
    Data14=join_3,
    Data15="]",
    Data16="}",
    Data17="}")
vec2pt = Vector2Pt(PointA=Point(0, 0, 0), PointB=dispatch_2.ListA, Unitize=False)  # -> Vector, Length
rotate = Rotate(Geometry=pshift_15, Angle=degrees(dispatch_3.ListA), Plane=PlaneXY(0, 0, 0))  # -> Geometry, Transform
dispatch_4 = Dispatch(List=pt_14, DispatchPattern=and)  # -> ListA, ListB
move_2 = Move(Geometry=mesh_10, Motion=vec2pt.Vector)  # -> Geometry, Transform
join_6 = TextJoin(Text=merge_5)
vec2pt_2 = Vector2Pt(PointA=Point(0, 0, 0), PointB=dispatch_4.ListA, Unitize=False)  # -> Vector, Length
move_3 = Move(Geometry=rotate.Geometry, Motion=vec2pt_2.Vector)  # -> Geometry, Transform

# ---- group: JSON Text
txt_16 = Text(join_6)

# ----
panel_18 = Panel(txt_16)

# ---- group: building lego modules
mesh_11 = Mesh(move_3.Geometry)

# ---- group: blank
mesh_12 = Mesh(move_2.Geometry)

# ---- group: module center
pt_15 = Point(pt_14)

# ---- group: 3D building site move amount
# 3D City Grid System Visualization
panel_19 = Panel("10000")
X = UnitX(Factor=panel_19)

# ---- group: module id
int_36 = Integer(int_14)

# ----
# Send to CityI/O Server
panel_20 = Panel("https://cityio.media.mit.edu")

# ---- group: table name on server
panel_21 = Panel("citymatrix_template")

# ----
com = ColourSwatch(SwatchColor=RGB(158, 158, 158))
com_2 = ColourSwatch(SwatchColor=RGB(71, 71, 71))
res = ColourSwatch(SwatchColor=RGB(212, 212, 212))
res_2 = ColourSwatch(SwatchColor=RGB(76, 76, 76))

# ---- group: blank
mesh_13 = Mesh(mesh_12)

# ----
larger_2 = LargerThan(FirstNumber=int_36, SecondNumber="0")  # -> LargerThan, OrEqualTo
smaller_3 = SmallerThan(FirstNumber=int_36, SecondNumber="5")  # -> SmallerThan, OrEqualTo

# ---- group: road mesh final!
mesh_14 = Mesh()

# ---- group: sidewalk mesh final!
mesh_15 = Mesh()

# ----
vec = Vector(X)
merge_6 = Merge(Data1=res, Data2=res, Data3=res, Data4=com, Data5=com, Data6=com)
merge_7 = Merge(Data1=res_2, Data2=res_2, Data3=res_2, Data4=com_2, Data5=com_2, Data6=com_2)
and_2 = GateAnd(A=larger_2.OrEqualTo, B=smaller_3.OrEqualTo)
merge_8 = Merge(Data1=merge_6, Data2=merge_7)

# ---- group: is building or not
bool_3 = Boolean(and_2)

# ---- group: cell size
num_4 = Number(division_4)

# ----
dispatch_5 = Dispatch(List=pt_15, DispatchPattern=bool_3)  # -> ListA, ListB
dispatch_6 = Dispatch(List=int_36, DispatchPattern=bool_3)  # -> ListA, ListB

# ---- group: color for each type
col_6 = Colour(merge_8)

# ----
division_5 = Division(A=num_4, B=2)

# ---- group: building center
pt_16 = Point(dispatch_5.ListA)

# ---- group: building id
int_37 = Integer(dispatch_6.ListA)

# ----
equals = Equality(FirstNumber=int_37)  # -> Equality, Inequality
multiplication_9 = Multiplication(A=equals.Inequality, B=6)

# ---- group: JSON Text
txt_17 = Text(txt_16)

# ----
move_4 = Move(Geometry=mesh_14, Motion=vec)  # -> Geometry, Transform
move_5 = Move(Geometry=mesh_15, Motion=vec)  # -> Geometry, Transform

# ---- group: base height
panel_22 = Panel("5.0")

# ----
move_6 = Move(Geometry=mesh_13, Motion=vec)  # -> Geometry, Transform
multiplication_10 = Multiplication(A=division_5, B=Slider(0.95, range=0..1))
addition_6 = Addition(A=int_37, B=multiplication_9)
join_7 = TextJoin(Text=["api/table/update/", panel_21])
join_8 = TextJoin(Text=["https://cityio.media.mit.edu/api/table/", panel_21])

# ---- group: url for reading the table json data - copy past to broswer
panel_23 = Panel(join_8)

# ----
neg = Negative(Value=multiplication_10)

# ---- group: delay sending
dam = DataDam(DataA=txt_17, BufferDelay=5000000, BufferMode=2)

# ----
filter_2 = StreamFilter(Gate=0, Stream0=addition_6, Stream1=int_37)
item_12 = ListItem(List=col_6, Index=graft(filter_2), Wrap=False)
pshift_16 = ShiftPaths(Data=item_12, Offset=-1)
dom = ConstructDomain(DomainStart=neg, DomainEnd=multiplication_10)
panel_24 = Panel(num)
send_table_data = PythonScript(url=panel_20, path=join_7, jsonString=dam)  # -> out
# ---------- send_table_data: Python ----------
import System 
import System.Net 
import System.Uri
import System.IO
import System.Text.Encoding
import json


def postTable(url,stringData,debug=False):
    webclient = System.Net.WebClient()
    webclient.Headers['Content-type'] = 'text/plain'
    
    if debug:
        
        # simple validation before we send
        try:
            json.loads(stringData)
        except:
            print 'invalid string, revise your string data'
            return
        
        # this will block your process
        data = System.Text.Encoding.Default.GetBytes(stringData)
        webclient.UploadData(url,'POST',data)
        
    else:
        data = System.Text.Encoding.Default.GetBytes(stringData)
        webclient.UploadDataAsync(url,'POST',data)

endpoint = System.Uri('{}/{}'.format(url,path))



postTable(endpoint,jsonString)
# rhino crashes using async callbacks,
# so try the following if something is wrong
# postData(endpoint,jsonString,debug=True)
# ---------- end send_table_data ----------

# ---- group: color for each building
col_7 = Colour(pshift_16)

# ----
item_13 = ListItem(List=panel_24, Index=graft(int_37), Wrap=False)
pshift_17 = ShiftPaths(Data=item_13, Offset=-1)

# ---- group: building height factor
number_slider_3 = Slider(3.1, range=0..10)

# ---- group: errors
panel_25 = Panel(send_table_data)

# ----
multiplication_11 = Multiplication(A=pshift_17, B=number_slider_3)

# ---- group: building height of each building
num_5 = Number(multiplication_11)

# ----
addition_7 = Addition(A=num_5, B=panel_22)
dom_2 = ConstructDomain(DomainStart=0, DomainEnd=addition_7)
box_3 = DomainBox(Base=pt_16, X=dom, Y=dom, Z=dom_2)
move_7 = Move(Geometry=box_3, Motion=vec)  # -> Geometry, Transform

# ---- group: building geo
box_4 = Box(move_7.Geometry)

# ---- group: 3D Buldings
preview_7 = CustomPreview(Geometry=box_4, Shader=col_7)

# ---- group: road
mesh_16 = Mesh(move_4.Geometry)

# ---- group: sidewalk
mesh_17 = Mesh(move_5.Geometry)

# ---- group: blank
mesh_18 = Mesh(move_6.Geometry)

# ==== cluster ModuleCenter
pt = ClusterInput()
int = ClusterInput()
num = ClusterInput()
int_2 = ClusterInput()

# ---- group: y
int_3 = Integer(int)

# ---- group: cell size
num_2 = Number(num)

# ---- group: x
int_4 = Integer(int_2)

# ---- group: center
pt_2 = Point(pt)

# ----
pt_3 = ConstructPoint(XCoordinate=0, YCoordinate=0, ZCoordinate=0)  # disabled
addition = Addition(A=int_4, B=0.5)
vec2pt = Vector2Pt(PointA=pt_3, PointB=pt_2, Unitize=False)  # -> Vector, Length; disabled
addition_2 = Addition(A=int_3, B=0.5)
multiplication = Multiplication(A=addition, B=num_2)
move = Move(Motion=vec2pt.Vector)  # -> Geometry, Transform; disabled
lng = ListLength(List=int_4)  # disabled
multiplication_2 = Multiplication(A=addition_2, B=num_2)
X = UnitX(Factor=multiplication)
repeat = RepeatData(Data=move.Transform, Length=lng)  # disabled
neg = Negative(Value=multiplication_2)
move_2 = Move(Geometry=pt_2, Motion=X)  # -> Geometry, Transform
graft = GraftTree(Tree=move_2.Transform, IncludeEmptyLists=True, IncludeNullItems=True)  # disabled
Y = UnitY(Factor=neg)
pshift = ShiftPaths(Data=repeat, Offset=-1)  # disabled
move_3 = Move(Geometry=move_2.Geometry, Motion=Y)  # -> Geometry, Transform
graft_2 = GraftTree(Tree=move_3.Transform, IncludeEmptyLists=True, IncludeNullItems=True)  # disabled
comp = Compound(Transforms=[graft, graft_2])  # disabled
graft_3 = GraftTree(Tree=pshift, IncludeEmptyLists=True, IncludeNullItems=True)  # disabled
comp_2 = Compound(Transforms=[comp, graft_3])  # disabled

# ---- group: module center
pt_4 = Point(move_3.Geometry)

# ----
pshift_2 = ShiftPaths(Data=comp_2, Offset=-1)  # disabled
transform = Transform(pshift_2)  # disabled
pt_5 = ClusterOutput(pt_4)
transform_2 = ClusterOutput(transform)  # disabled

# ==== cluster MoveToOrgin
num = ClusterInput()
G = ClusterInput()
num_2 = Number(num)
geobottomcenter = GeoBottomCenter(geo=G)
vec2pt = Vector2Pt(PointA=geobottomcenter, PointB=Point(0, 0, 0), Unitize=False)  # -> Vector, Length
move = Move(Geometry=G, Motion=vec2pt.Vector)  # -> Geometry, Transform
scale_nu = ScaleNU(Geometry=move.Geometry, Plane=PlaneXY(0, 0, 0), ScaleX=num_2, ScaleY=num_2, ScaleZ=1)  # -> Geometry, Transform
G_2 = ClusterOutput(scale_nu.Geometry)

# ==== cluster Perspective
int = ClusterInput()
int_2 = ClusterInput()
pt = ClusterInput()

# ---- group: grid extent y
int_3 = Integer(int)

# ---- group: grid extent x
int_4 = Integer(int_2)

# ---- group: Pts Sample Grid Corner
pt_2 = Point(pt)

# ----
subtraction = Subtraction(A=int_4, B=1)
subtraction_2 = Subtraction(A=int_3, B=1)
item = ListItem(List=pt_2, Index=0, Wrap=False)
item_2 = ListItem(List=pt_2, Index=1, Wrap=False)
item_3 = ListItem(List=pt_2, Index=2, Wrap=False)
item_4 = ListItem(List=pt_2, Index=3, Wrap=False)
pt_3 = Point(item_4)
pt_4 = Point(item)
ln = Line(StartPoint=pt_3, EndPoint=pt_4)
pt_5 = Point(item_2)
ln_2 = Line(StartPoint=pt_4, EndPoint=pt_5)
pt_6 = Point(item_3)
ln_3 = Line(StartPoint=pt_6, EndPoint=pt_3)
ln_4 = Line(StartPoint=pt_5, EndPoint=pt_6)
llx = LineLine(Line1=ln, Line2=ln_4)  # -> ParamA, ParamB, PointA, PointB
pt_7 = Point(llx.PointA)
llx_2 = LineLine(Line1=ln_2, Line2=ln_3)  # -> ParamA, ParamB, PointA, PointB
pt_8 = Point(llx_2.PointA)
vec2pt = Vector2Pt(PointA=pt_8, PointB=pt_7, Unitize=False)  # -> Vector, Length
line = LineSDL(Start=pt_3, Direction=vec2pt.Vector, Length=1)
llx_3 = LineLine(Line1=ln_2, Line2=line)  # -> ParamA, ParamB, PointA, PointB
pt_9 = Point(llx_3.PointA)
ln_5 = Line(StartPoint=pt_3, EndPoint=pt_9)
divide = DivideCurve(Curve=ln_5, Count=subtraction_2, Kinks=False)  # -> Points, Tangents, Parameters
ln_6 = Line(StartPoint=pt_8, EndPoint=divide.Points)
llx_4 = LineLine(Line1=ln_4, Line2=line)  # -> ParamA, ParamB, PointA, PointB
pt_10 = Point(llx_4.PointA)
ln_7 = Line(StartPoint=pt_3, EndPoint=pt_10)
divide_2 = DivideCurve(Curve=ln_7, Count=subtraction, Kinks=False)  # -> Points, Tangents, Parameters
ln_8 = Line(StartPoint=pt_7, EndPoint=divide_2.Points)
ln_9 = Line(StartPoint=pt_8, EndPoint=pt_7)

# ---- group: x
line_2 = Line(ln_8)

# ---- group: y
line_3 = Line(ln_6)

# ----
graft = GraftTree(Tree=ln_6, IncludeEmptyLists=True, IncludeNullItems=True)
llx_5 = LineLine(Line1=line_2, Line2=graft)  # -> ParamA, ParamB, PointA, PointB

# ---- group: keystoned grid pts
pt_11 = Point(llx_5.PointA)

# ----
pt_12 = ClusterOutput(pt_11)

# ==== cluster TextFormating
txt = ClusterInput()
txt_2 = Text(txt)

# ---- group: 'Enter'
panel = Panel("")

# ----
split = TextSplit(Text=txt_2, Separators=panel)
lng = ListLength(List=split)
addition = Addition(A=lng, B=1)
division = Division(A=addition, B=2)
series = Series(Start=0, Step=2, Count=division)
item = ListItem(List=split, Index=series, Wrap=False)
pshift = ShiftPaths(Data=item, Offset=1)
graft = GraftTree(Tree=pshift, IncludeEmptyLists=True, IncludeNullItems=True)
split_2 = TextSplit(Text=graft, Separators=",")
pshift_2 = ShiftPaths(Data=split_2, Offset=-2)
txt_3 = Text(pshift_2)
txt_4 = ClusterOutput(txt_3)

# ==== cluster GeoBottomCenter
geo = ClusterInput()
geo_2 = Geometry(geo)
bbox = BoundingBox(Content=geo_2, Plane=PlaneXY(0, 0, 0))  # -> Box, Box_2
box_corners = BoxCorners(Box=bbox.Box)  # -> CornerA, CornerB, CornerC, CornerD, CornerE, CornerF, CornerG, CornerH
pdecon = Deconstruct(Point=box_corners.CornerA)  # -> XComponent, YComponent, ZComponent
pdecon_2 = Deconstruct(Point=box_corners.CornerC)  # -> XComponent, YComponent, ZComponent
addition = Addition(A=pdecon.XComponent, B=pdecon_2.XComponent)
addition_2 = Addition(A=pdecon.YComponent, B=pdecon_2.YComponent)
division = Division(A=addition, B=2)
division_2 = Division(A=addition_2, B=2)
pt = ConstructPoint(XCoordinate=division, YCoordinate=division_2, ZCoordinate=pdecon.ZComponent)
pt_2 = Point(pt)
pt_3 = ClusterOutput(pt_2)
